# Grasshopper definition whatsapp-generation.gh (Grasshopper 1.0.7)
# plug-ins: Bifocals, Kangaroo2 Components, jSwan

# ----
# 1
# Link your JSON file here
# It should look like the example panel below
panel = Panel("""[{
		"names": ["A", "B", "C", "D", "E", "F", "G", "H", "I", "J"],
		"nbMessages": [6, 17, 21, 27, 0, 33, 7, 25, 0, 29],
		"nbChar": [202, 444, 903, 528, 0, 761, 79, 751, 0, 973]
	},
	{
		"names": ["A", "B", "C", "D", "E", "F", "G", "H", "I", "J"],
		"nbMessages": [13, 19, 21, 15, 4, 17, 11, 32, 0, 13],
		"nbChar": [294, 817, 886, 386, 142, 441, 205, 1362, 0, 394]
	}]""")
file_path = FilePath()

# ----
# 2
# Max value should be the length of your data list
# Change the slider before running to generate a shape for the time-frame you want
number_slider = Slider(0, range=0..1)

deserialize_json = DeserializeJson(JSON=panel, OutputsLocked=False)

# ----
# Sum of messages of all the people for a time-frame
deserialize_json_2 = DeserializeJson(JSON=deserialize_json, OutputsLocked=False)  # -> Names, NbMessages, NbChar
mass_addition = MassAddition(Input=deserialize_json_2.NbMessages)  # -> flatten(Result), PartialResults

list_item = ListItem(List=deserialize_json, Index=number_slider, Wrap=True)

# ----
# 3
# Starting curves
curve = Curve([<curve referenced from the Rhino model> x10])

deserialize_json_3 = DeserializeJson(JSON=list_item, OutputsLocked=False)  # -> Names, NbMessages, NbChar
divide = DivideCurve(Curve=curve, Count=expr("x+3", deserialize_json_3.NbMessages), Kinks=False)  # -> simplify(Points), Tangents, Parameters

# ---- group: Random movement to avoid stalling of straight lines
vec = Vector(divide.Points)
amp = Amplitude(Vector=vec, Amplitude="0.25")
lng = ListLength(List=amp)
random = Random(Range="0 to 2*Pi", Number=lng, Seed=2)
rotate = Rotate(Geometry=amp, Angle=random, Plane=PlaneXY(0, 0, 0))  # -> simplify(Geometry), Transform

# ---- group: Controls
# 4
# Controls the length of the shapes' segments
# (start low and increase slowly)
# Controls the radius of the collision circles between the shapes
# (increase if needed)
number_slider_2 = Slider(0.793, range=0.3..16)
number_slider_3 = Slider(1.172, range=1..100)
reset = Button()
on = BooleanToggle(False)

# ---- group: Boundary surface
# External delimiting shape
curve_2 = Curve(<curve referenced from the Rhino model>)
boundary_surfaces = BoundarySurfaces(Edges=curve_2)
mesh_brep = MeshBrep(
    Brep=boundary_surfaces,
    Settings={GridMaxCount=0, GridMinCount=16, JaggedSeams=False, MaxEdgeLength=0, MinEdgeLength=0.0001, MinTolerance=0, Refine=True, RefineAngle=0, RelativeTolerance=0.65, SimplePlanes=True, Tolerance=0})
mesh = Mesh(mesh_brep)

# ----
# Line growing & collision detection
toggle = BooleanToggle(True)
move = Move(Geometry=divide.Points, Motion=rotate.Geometry)  # -> Geometry, Transform
pline = PolyLine(Vertices=move.Geometry, Closed=toggle)  # -> flatten(Polyline)
explode = Explode(Curve=pline, Recursive=True)  # -> Segments, Vertices
list = ValueList({"One": 1, "Two": 2, "Three": 2² - 1, "Four": Sqrt(16)}, selected="Three")
multiplication = Multiplication(A=number_slider_2, B=list)
shift = ShiftList(List=explode.Segments, Shift=1, Wrap=True)
asd = Asd(line=explode.Segments)  # -> line_4, int_3, int_4
cluster = Cluster(pt=move.Geometry)  # -> pt_4, int_3, int_4
length_line = LengthLine(Line=flatten(explode.Segments), Length=number_slider_3, Strength="10")
onmesh = OnMesh(Points=move.Geometry, Mesh=mesh, Strength="2000")
angle = Angle(LineA=explode.Segments, LineB=shift, RestAngle="0", Strength="1500")
collider = Collider(Objects=cluster.pt_4, Radii=multiplication, IgnoreA=cluster.int_3, IgnoreB=cluster.int_4, Strength="1000")
collider_2 = Collider(Objects=asd.line_4, Radii=number_slider_2, IgnoreA=asd.int_3, IgnoreB=asd.int_4, Strength="1000")
show = Show(G=pline)
entwine = Entwine(
    Branch00=show,
    Branch01=onmesh,
    Branch02=length_line,
    Branch03=angle,
    Branch04=collider,
    Branch05=collider_2,
    FlattenInputs=True)
solver = Solver(GoalObjects=entwine, Reset=reset, Threshold=1e-15, Tolerance=0.01, On=on)  # -> I, V, flatten(O)

area = Area(Geometry=mesh)  # -> Area, Centroid

# ----
# Treating & interpolating the resulting polylines
bang = ExplodeTree(Data=solver.O)  # -> Branch0, Branch1
crv = Curve(bang.Branch0)
closed = Closed(Curve=crv)  # -> Closed, Periodic
cull_pattern = CullPattern(List=crv, CullPattern=closed.Closed)
explode_2 = Explode(Curve=cull_pattern, Recursive=True)  # -> Segments, Vertices
intcrv = Interpolate(Vertices=explode_2.Vertices, Degree=3, Periodic=graft(cull_pattern), KnotStyle=1)  # -> flatten(Curve), Length, Domain

# ----
# Bake the curves or the surfaces when you're done!
curve_3 = Curve(intcrv.Curve)
boundary_surfaces_2 = BoundarySurfaces(Edges=curve_3)

# ----
# Calculating the current % area taken by the growing shapes in the delimiting shape
area_2 = Area(Geometry=boundary_surfaces_2)  # -> Area, Centroid
mass_addition_2 = MassAddition(Input=area_2.Area)  # -> Result, PartialResults
number = Number(100)
multiplication_2 = Multiplication(A=mass_addition_2.Result, B=number)
division = Division(A=multiplication_2, B=area.Area)

# ----
# Area % control point (info only)
# If you want to compare the percentage area
# every time-frame should take in comparison to
#  the highest value, this source domain should be
# "0 to [highest number of messages for a time-frame]"
# (in the example: 0 to 165)
panel_2 = Panel(mass_addition.Result)
domain = Domain(Domain(0, 165))
domain_2 = Domain(Domain(0, 100))
remap_numbers = RemapNumbers(Value=panel_2, Source=domain, Target=domain_2)  # -> Mapped, Clipped
panel_3 = Panel(remap_numbers.Mapped)
panel_4 = Panel(division)

# ----
# Adding a name tag on each shape for reference
panel_5 = Panel(deserialize_json_3.Names)
area_3 = Area(Geometry=curve_3)  # -> Area, Centroid
text_tag = TextTag(Location=area_3.Centroid, Text=panel_5)

# ==== cluster Asd
line = ClusterInput()
line_2 = Line(line)
line_3 = Line(flatten(line_2))
lng = ListLength(List=line_3)
lng_2 = ListLength(List=line_2)  # -> flatten(Length)
series = Series(Start=0, Step=1, Count=lng)
line_4 = ClusterOutput(line_3)
partition = PartitionList(List=series, Size=lng_2)
shift = ShiftList(List=partition, Shift=1, Wrap=True)
int = Integer(flatten(partition))
int_2 = Integer(flatten(shift))
int_3 = ClusterOutput(int)
int_4 = ClusterOutput(int_2)

# ==== cluster Cluster
pt = ClusterInput()
pt_2 = Point(pt)
pt_3 = Point(flatten(pt_2))
lng = ListLength(List=pt_3)
lng_2 = ListLength(List=pt_2)  # -> flatten(Length)
series = Series(Start=0, Step=1, Count=lng)
pt_4 = ClusterOutput(pt_3)
partition = PartitionList(List=series, Size=lng_2)
shift = ShiftList(List=partition, Shift=1, Wrap=True)
int = Integer(flatten(partition))
int_2 = Integer(flatten(shift))
int_3 = ClusterOutput(int)
int_4 = ClusterOutput(int_2)
